# Grasshopper definition main.gh (Grasshopper 1.0.7)

crv = Curve(<curve referenced from the Rhino model>)
python = GhPythonScript(boundary=crv)  # -> out, segments, a; inputs boundary: Curve
# ---------- python: Python ----------
import fx

reload(fx)
reload(fx.tree)
reload(fx.utils)

from fx.window import draw_window
from fx.tree import main

tree_radius = 10
num_points = 10
#draw_window(segments[0])
a=main(tree_radius, num_points, boundary)
# ---------- end python ----------
incurve = PointInCurve()  # -> Relationship, Point
item = ListItem(List=python.segments, Index=Slider(0, range=0..10), Wrap=True)
